# Grasshopper definition 9_ML_Inference.ghx (Grasshopper 1.0.8)
# plug-ins: Eddy3D

select = SelectTemplate()
# How to?
# 
# -Please downlaod the ML models first (GAN and FNO).
#  Then assign them in the "File Path" components, respectively.
# 
# -Connect your input geometry to "Builidngs"
# 
# -Define wind speed/direction (optional).
# 
# -Define legend (optional).
select_2 = SelectTemplate()

# ---- group: model selection
list = ValueList({"GAN": 0, "GAN with TKE": 1}, selected="GAN")

# ---- group: FNO_ONXX file / GAN_with tke
path = FilePath("C:\Users\ilker\Desktop\Conditional_Transformer\Pix2PixHD_Model\pix2pixhd_uk_generator.onnx")

# ---- group: GAN
path_2 = FilePath("C:\Users\ilker\Desktop\Conditional_Transformer\Pix2PixHD_Model\pix2pixhd_generator.onnx")

# ----
entwine = Entwine(Branch00=path_2, Branch01=path, FlattenInputs=True)  # -> simplify(Result)
branch = TreeBranch(Tree=entwine, Path=list, MaintainPaths=False)

range = Range(Domain="0 To 337.5", Steps=15)

# ---- group: Terrain- Do not change / TERRAIN
srf = Surface(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)

# ----
list_2 = ValueList({"Velocity": 0, "Turbulent Kinetic Energy": 1}, selected="Velocity")

# ---- group: wind direction
list_3 = ValueList({"North": 0, "Northeast": 45, "East": 90, "Southeast": 135, "South": 180, "Southwest": 225, "West": 270, "Northwest": 315}, selected="Northeast")

# ---- group: Terrain- Do not change
move = Move(Geometry=srf, Motion=Vector(0, 0, 1.8))  # -> Geometry, Transform
brep2grid = BrepToGridPoints(Geometry=move.Geometry, Spacing="2", Run=True)  # -> Points, Status

# ---- group: Buildings
brep = Brep([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])

# ---- group: Wind Speed
panel = Panel("5")

# ---- group: Legend Settings
list_4 = ValueList({"Jet": "jet", "Turbo": "turbo", "Viridis": "viridis", "Magma": "magma", "Plasma": "plasma", "Inferno": "inferno", "Coolwarm": "coolwarm", "Pastel": "pastel", "Gray": "gray"}, selected="Coolwarm")
dom = ConstructDomain(DomainStart=0, DomainEnd=panel)

# ----
preview = CustomPreview(Geometry=brep, Material=ColourSwatch(SwatchColor=RGB(204, 204, 204)))
entwine_2 = Entwine(Branch00=dom, FlattenInputs=True)  # -> simplify(Result)
swatch = ColourSwatch(SwatchColor=RGB(255, 255, 255))
branch_2 = TreeBranch(Tree=entwine_2, Path=list_2, MaintainPaths=True)
windpredict = WindPredictor(
    Points=brep2grid.Points,
    Buildings=brep,
    ONNXPath=branch,
    U_ref=panel,
    Z_ref=10,
    Pedestrian_level=1.8,
    Wind_dir=list_3,
    GPU=True,
    FilterMargin=100,
    Palette=list_4,
    LegendDomain=branch_2,
    Interpolate=True,
    ShowTKE=list_2)  # -> X, Y, WindSpeed, GridMesh, LegendMesh, LegendPoints, LegendValues, TurbulentKineticEnergy, BoundaryConditions
compass = WindCompass(DirectionIndex=list_3, Radius=420, BasePoint=Point(0, 0, 0), Color=swatch, ArrowScale=0.5)  # -> Circle, Arrow
entwine_3 = Entwine(Branch00=windpredict.WindSpeed, Branch01=windpredict.TurbulentKineticEnergy, FlattenInputs=True)  # -> simplify(Result)
mesh = Mesh(windpredict.GridMesh)
mesh_2 = Mesh(windpredict.LegendMesh)
tag = TextTag3D(Location=windpredict.LegendPoints, Text=windpredict.LegendValues, Size=14, Colour=swatch, Justification=5)
area = Area(Geometry=mesh_2)  # -> Area, Centroid
branch_3 = TreeBranch(Tree=entwine_3, Path=list_2, MaintainPaths=True)
bnd = Bounds(Numbers=branch_3)

# ---- group: Wind speed range
panel_2 = Panel(bnd)

# ----
Y = UnitY(Factor=-100)
Y_2 = UnitY(Factor=-50)
move_2 = Move(Geometry=area.Centroid, Motion=Y)  # -> Geometry, Transform
move_3 = Move(Geometry=move_2.Geometry, Motion=Y_2)  # -> Geometry, Transform
concat = Concatenate(
    FragmentA="Incoming wind direction & speed: ",
    FragmentB=compass.Arrow,
    FragmentC=", ",
    FragmentD=panel,
    FragmentE=" m/s")
concat_2 = Concatenate(FragmentA="Min - Max: ", FragmentB=panel_2)
tag_2 = TextTag3D(Location=move_2.Geometry, Text=concat_2, Size=16, Colour=swatch, Justification=5)
tag_3 = TextTag3D(Location=move_3.Geometry, Text=concat, Size=16, Colour=swatch, Justification=5)
