# Grasshopper definition FluidX3D.ghx (Grasshopper 1.0.8)
# plug-ins: Outdoor, FluidX3D

atmospheric_boundary_layer = AtmosphericBoundaryLayer(
    ReferenceHeight=10,
    RoughnessLengthZ0=1,
    GroundHeight=0,
    TurbulentKEK=0.015,
    TurbulentEpsilonΕ=0.135,
    TurbulentOmegaΩ=100)  # -> BoundaryConditions, WindVectors, AirABLSettings
fluidx3d_run_settings = FluidX3DRunSettings(Memory=1000, SimTime=360, ExportInterval=30, GroundZ=0, Interactive=False, FluidX3DRunSettingsInputLayoutVersion=2)
geometry = Geometry(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)
fluidx3d_run = FluidX3DRun(
    ABL=atmospheric_boundary_layer.BoundaryConditions,
    Buildings=geometry,
    Settings=fluidx3d_run_settings,
    Prepare=False,
    Run=False,
    Fx3dInputLayoutVersion=2)  # -> Logs, Folder, Case, Domain
geometry_2 = Geometry(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)
surface = Surface(geometry_2)
quad_remesh = QuadRemesh(Geometry=surface, Settings={aqc=True, as=50, dhe=True, gci=0, null=False, pme=2, sa=0, tqc=2000})
wires = BrepWireframe(Brep=fluidx3d_run.Domain, Density=-1)
fluidx3d_live_view = FluidX3DLiveView(Case=fluidx3d_run.Case, Mesh=quad_remesh, Live=False, MaxSpeed=0, AvgWindow=300)  # -> Mesh, Speeds, Time, Status
mesh = Mesh(fluidx3d_live_view.Mesh)
