# Grasshopper definition Sun_Hours.ghx (Grasshopper 1.0.8)
# plug-ins: MetaMAP, Outdoor, Eddy3D, Eddy3D-Radiance

number_slider = Slider(500, range=0..500)
data = Data(33.78217037)
data_2 = Data(-84.37803626)
panel = Panel(data)
panel_2 = Panel(data_2)
metaterrain = MetaTERRAIN(Latitude=panel, Longitude=panel_2, Radius=number_slider, GridResolution="5")  # -> TerrainBrep, ElevationPoints, ElevationValues, Status
metabuilding = MetaBuilding(Latitude=panel, Longitude=panel_2, Radius=expr("x-100", number_slider), Terrain=metaterrain.TerrainBrep)  # -> BuildingBreps, BuildingHeights, Status
panel_3 = Panel(metabuilding.Status)
custom_preview = CustomPreview(Geometry=metaterrain.TerrainBrep, Material=ColourSwatch(SwatchColor=RGB(133, 133, 133)))
custom_preview_2 = CustomPreview(Geometry=metabuilding.BuildingBreps, Material=ColourSwatch(SwatchColor=RGB(255, 255, 255)))

# ---- group: Ground Surface
brep = Brep(metaterrain.TerrainBrep)

# ----
brep_grid_points = BrepGridPoints(Geometry=brep, Spacing="2")  # -> Points, Vectors, Mesh, Status
download_weather = DownloadWeather(Search="Atlanta")  # -> EPWFile, Logs, Stations
deconstruct_mesh = DeconstructMesh(Mesh=brep_grid_points.Mesh)  # -> Vertices, Faces, Colours, Normals
context = Brep(metabuilding.BuildingBreps)
deconstruct_weather = DeconstructWeather(Weather=download_weather.EPWFile, Series="""Solar Elevation
Solar Azimuth
Latitude
Longitude""")  # -> SolarElevation, SolarAzimuth, Latitude, Longitude
mjoin = MeshJoin(Meshes=context)
sun_hours = SunHours(
    Context=mjoin,
    Points=deconstruct_mesh.Vertices,
    SunElevation=deconstruct_weather.SolarElevation,
    SunAzimuth=deconstruct_weather.SolarAzimuth,
    StartHour=0,
    EndHour=8760,
    Offset=0.01)  # -> SunHours, Fraction, Colors, Report
panel_4 = Panel(sun_hours.Report)

# ---- group: Mean
bnd = Bounds(Numbers=sun_hours.SunHours)
dedomain = DeconstructDomain(Domain=bnd)  # -> Start, End
gradient = Gradient(
    LowerLimit=dedomain.Start,
    UpperLimit=dedomain.End,
    Parameter=sun_hours.SunHours,
    stops=[0: RGB(48, 18, 59), 0.0294: RGB(56, 40, 112), 0.0588: RGB(63, 62, 156), 0.0882: RGB(68, 82, 193), 0.118: RGB(70, 102, 221), 0.147: RGB(71, 122, 241)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])

# ----
construct_mesh = ConstructMesh(Vertices=deconstruct_mesh.Vertices, Faces=deconstruct_mesh.Faces, Colours=gradient)
