# Grasshopper definition SurfaceTemps_FFT.ghx (Grasshopper 1.0.8)
# plug-ins: Outdoor, Eddy3D-Radiance

# ---- group: Ground Surface
brep = Brep(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)

# ----
brepgrid = BrepGridPoints(Geometry=brep, Spacing=Slider(2, range=0..10))  # -> Points, Vectors, Mesh, Status
context = Brep([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])
panel = Panel("https://energyplus-weather.s3.amazonaws.com/europe_wmo_region_6/TUR/TUR_Istanbul.170600_IWEC/TUR_Istanbul.170600_IWEC.epw")
preview = CustomPreview(Geometry=context, Material=ColourSwatch(SwatchColor=RGB(255, 255, 255)))
sky_exposure = SkyExposure(Positions=brepgrid.Points, Context=context, Offset=0.918)
surfacetemp_material = SurfaceTempMaterial(MaterialList="grass_ground")
download_weather = DownloadWeather(Search=panel)  # -> EPWFile, Logs, Stations
hoy = HourOfYear(
    StartMonth=Slider(1, range=1..12),
    StartDay=Slider(7, range=1..30),
    StartHour=Slider(0, range=0..23),
    EndMonth=Slider(12, range=1..12),
    EndDay=Slider(31, range=1..31),
    EndHour=Slider(23, range=0..23))  # -> HoursOfYear, DateTimes
surfacetemp = SurfaceTemp(
    Points=brepgrid.Points,
    Vectors=brepgrid.Vectors,
    EPW=download_weather.EPWFile,
    Material=surfacetemp_material,
    IndoorTemp=22,
    SkyView=sky_exposure,
    Run=True,
    SurfaceTempPersistResults=False)
calendar = Calendar(Day=24, Hour=0, Month=7)
deconstruct_surfacetemp = DeconstructSurfaceTemp(Result=surfacetemp)  # -> Mean, Min, Max, SurfaceTemp

# ---- group: Mean
bnd = Bounds(Numbers=deconstruct_surfacetemp.Mean)
cir = Circle(Plane=brepgrid.Points, Radius=1)
dedomain = DeconstructDomain(Domain=bnd)  # -> Start, End
panel_2 = Panel(deconstruct_surfacetemp.Mean)
gradient = Gradient(
    LowerLimit=dedomain.Start,
    UpperLimit=dedomain.End,
    Parameter=deconstruct_surfacetemp.Mean,
    stops=[0: RGB(48, 18, 59), 0.0294: RGB(56, 40, 112), 0.0588: RGB(63, 62, 156), 0.0882: RGB(68, 82, 193), 0.118: RGB(70, 102, 221), 0.147: RGB(71, 122, 241)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])
srf = Surface(cir)
round = Round(Number=panel_2)  # -> Nearest, Floor, Ceiling
preview_2 = CustomPreview(Geometry=srf, Material=gradient)
tag = TextTag(Location=brepgrid.Points, Text=round.Nearest, Colour=ColourSwatch(SwatchColor=RGB(255, 255, 255)))

# ---- group: Max
bnd_2 = Bounds(Numbers=deconstruct_surfacetemp.Max)  # disabled
dedomain_2 = DeconstructDomain(Domain=bnd_2)  # -> Start, End; disabled
panel_3 = Panel(deconstruct_surfacetemp.Max)  # disabled
gradient_2 = Gradient(
    LowerLimit=dedomain_2.Start,
    UpperLimit=dedomain_2.End,
    Parameter=deconstruct_surfacetemp.Max,
    stops=[0: RGB(255, 254, 255), 1: RGB(0, 0, 0)])  # disabled
cir_2 = Circle(Plane=brepgrid.Points, Radius=1)  # disabled
panel_4 = Panel("-200")  # disabled
unit_y = UnitY(Factor=panel_4)  # disabled
move = Move(Geometry=cir_2, Motion=unit_y)  # -> Geometry, Transform; disabled
move_2 = Move(Geometry=brepgrid.Points, Motion=unit_y)  # -> Geometry, Transform; disabled
round_2 = Round(Number=panel_3)  # -> Nearest, Floor, Ceiling; disabled
swatch = ColourSwatch(SwatchColor=RGB(255, 255, 255))  # disabled
preview_3 = CustomPreview(Geometry=move.Geometry, Material=gradient_2)  # disabled
tag_2 = TextTag(Location=move_2.Geometry, Text=round_2.Nearest, Colour=swatch)  # disabled
