# Grasshopper definition CylinderDomain.ghx (Grasshopper 1.0.8)
# plug-ins: Outdoor, Eddy3D

download_weather = DownloadWeather(Station="Atlanta")  # -> EPWFile, Logs, Stations, Station, ExtraFiles
deconstruct_weather = DeconstructWeather(
    Weather=download_weather.EPWFile,
    Series="""Dry Bulb Temperature
Relative Humidity
Wind Speed
Wind Direction
Solar Elevation
Solar Azimuth
Hour of Year
Latitude
Longitude""")  # -> DryBulbTemperature, RelativeHumidity, WindSpeed, WindDirection, SolarElevation, SolarAzimuth, HourOfYear, Latitude, Longitude
wind_rose_cluster = WindRoseCluster(
    Directions=deconstruct_weather.WindDirection,
    Budget="8",
    WindSpeeds=deconstruct_weather.WindSpeed,
    Series="""Wind Directions
Wind Speeds""")  # -> WindDirections, WindSpeeds
atmospheric_boundary_layer = AtmosphericBoundaryLayer(
    WindDirections=wind_rose_cluster.WindDirections,
    WindSpeed=wind_rose_cluster.WindSpeeds,
    ReferenceHeight=10,
    RoughnessLengthZ0=1,
    GroundHeight=0,
    TurbulentKEK=0.015,
    TurbulentEpsilonΕ=0.135,
    TurbulentOmegaΩ=100,
    TerrainType="Custom (z0 input)",
    AblOutputLayoutVersion=2)  # -> BoundaryConditions, WindVectors
run_settings = RunSettings(
    Iterations="200",
    WriteInterval=20,
    KeepTimeSteps=3,
    TurbulenceModel="realizableKE",
    CPUCount=-1,
    SolverAlgorithm="SIMPLE",
    AgeOfAir=False,
    Numerics="0,0.5,0.5",
    PotentialFoamInit=True,
    WarmUpIterations=-1,
    FieldMonitors=False,
    PedestrianAverage=False,
    PressureCoefficient=False,
    Convergence=0.0001,
    AutoStopOnPlateau=False,
    Duration=-1,
    TimeStep=-1,
    MaxCourant=-1,
    AveragingWindow=-1,
    PressureSolver="GAMG",
    LaplacianScheme="auto",
    MeshQualityPreset="auto")  # -> RunSettings, DebugLogs
cylinder_domain = CylinderDomain(
    CoreCellSize=40,
    InnerCoreSize=-1,
    OuterRadius=-1,
    Height=-1,
    RadialMultiplier=2,
    CoreDivisions=1,
    RefinementBoxExtension=-1,
    RadialGrading=1,
    CoreRoundness=0.65,
    VerticalGrading=1)
land_cover_roughness = LandCoverRoughness(
    Latitude="33.78145186480617",
    Longitude="-84.37722219362138",
    Radius="700",
    TerrainRadius="700",
    Anchor=PlaneXY(0, 0, 0),
    RefinementLevel=2,
    Fetch=Button(),
    LandZ0InputLayoutVersion=2)  # -> GroundZones, Boundaries, RoughnessLengths, LandCover, Terrain, SiteElevation
geometry = Geometry(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)
geometry_2 = Geometry(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)
geometry_3 = Geometry(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)
geometry_4 = Geometry([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])
curve = Curve(land_cover_roughness.Boundaries)
tree = Tree(Geometry=geometry, Type="live oak")
geometry_5 = Geometry(land_cover_roughness.Terrain)
tree_2 = Tree(Geometry=geometry_2, Type="dense")
tree_3 = Tree(Geometry=geometry_3, Type="silver birch")
outdoor_case = OutdoorCase(
    BoundaryConditions=atmospheric_boundary_layer.BoundaryConditions,
    DomainParameters=cylinder_domain,
    Buildings=geometry_4,
    Trees=[tree, tree_2, tree_3],
    Terrain=land_cover_roughness.Terrain,
    RunSettings=run_settings.RunSettings,
    GroundRoughness=land_cover_roughness.GroundZones,
    Engine="BlueCFD",
    Write=False,
    ClearCase=False,
    AutoName="merry-lemur-dune-quill",
    OutdoorCaseInputLayoutVersion=5,
    PreviewBuildings=False,
    PreviewDimensions=True,
    PreviewGrid3D=True,
    PreviewGroundGrid=True,
    PreviewRefinementBox=True,
    PreviewWindArrows=True)  # -> Logs, WriteLogs, Case, Domain, RefinementBox, Buildings
plot_residuals = PlotResiduals(Case=outdoor_case.Case, Plot=False, ResidualViewerTarget=0)
meshing_progress = MeshingProgress(Case=outdoor_case.Case, Live=True)  # -> Progress, Phase, Done, Status
live_residuals = LiveResiduals(Case=outdoor_case.Case, Live=True, DirectionDegrees=-1)
parse_case_logs = ParseCaseLogs(Case=outdoor_case.Case, Run=True)  # -> LogSummary, Errors, Warnings
run = Run(
    Case=outdoor_case.Case,
    Mesh=False,
    CreateZones=False,
    Simulate=False,
    RunAll=False,
    Parallel=True,
    DirectionIndex=-1,
    ShowZones=True)
open_in_paraview = OpenInParaView(Case=outdoor_case.Case, Open=False, ComfortMetric=1, DirectionIndex=-1, ParaviewInputLayoutVersion=2, Streamlines=True)
panel = Panel(parse_case_logs.LogSummary)
mesh_intersection = MeshIntersection(MeshesA=geometry_5, MeshesB=outdoor_case.Domain)
deconstruct_mesh = DeconstructMesh(Mesh=mesh_intersection)  # -> Vertices, Faces, Colours, Normals
unit_z = UnitZ(Factor="1.5")
move = Move(Geometry=deconstruct_mesh.Vertices, Motion=unit_z)  # -> Geometry, Transform
probe = Probe(
    Case=outdoor_case.Case,
    Points=move.Geometry,
    Field="U",
    Run=False,
    AutoProbeName="sunny-ferret-mesa-compass",
    BakeTimeHistory=False,
    CullHugeVectors=True,
    CullInvalid=True,
    ShowRegion=False)  # -> Values, TimeSteps, SubResults
tree_branch = TreeBranch(Tree=simplify(probe.Values), Path=Slider(7, range=0..7), MaintainPaths=True)
vector_field_viewer = VectorFieldViewer(
    Points=move.Geometry,
    Velocity=tree_branch,
    DisplayMode="Vector Field",
    Scale=1,
    ColorMap="Viridis",
    SeedCount=120,
    ArrowheadScaling="Fixed",
    VectorPlane="3D")  # -> Geometry, Colors, Range
